# Grasshopper definition Componentes de quantificação.gh (Grasshopper 1.0.7)

ghpython_script = GhPythonScript()  # -> out, altura_viga_largura, altura_viga_profundidade, volume_concreto_vigas, area_forma_vigas
# ---------- ghpython_script: Python ----------
__author__ = "brunobrito"

class preDimensionamento_viga:
    def __init__(self, caso_carga, vao):
        self.caso_carga = caso_carga
        self.vao = vao

    def altura_viga(self):
        if self.caso_carga == 0:
            return self.vao * 0.08
        elif self.caso_carga == 1:
            return self.vao * 0.1
        elif self.caso_carga == 2:
            return self.vao * 0.12

    def base_viga(self):
        return self.altura_viga() * 0.3
    
    # TODO: corrigir volume de viga abatendo a sobreposição com a laje de concreto. Precisa diminuir a altura da viga
    def volume_viga(self):
        return self.altura_viga() * self.base_viga() * self.vao
    
    def area_forma(self):
        return (self.base_viga() + self.altura_viga() + self.altura_viga()) * self.vao
    
    def peso_aco(self):
        return self.volume_viga() * 100
        


viga_profundidade = preDimensionamento_viga(caso_carga, vao_viga_profundidade)
viga_largura = preDimensionamento_viga(caso_carga, vao_viga_largura)


volume_concreto_profundidade = viga_profundidade.volume_viga()
altura_viga_profundidade = viga_profundidade.altura_viga()

volume_concreto_largura = viga_largura.volume_viga()
altura_viga_largura = viga_largura.altura_viga()
print(viga_largura.base_viga())
print(viga_profundidade.base_viga())

volume_concreto_vigas = (volume_concreto_profundidade * numero_viga_profundidade) + (volume_concreto_largura * numero_viga_largura)


area_forma_profundidade = viga_profundidade.area_forma()
area_forma_largura = viga_largura.area_forma()

area_forma_vigas = (area_forma_profundidade * numero_viga_profundidade) + (area_forma_largura * numero_viga_largura)
# ---------- end ghpython_script ----------
ghpython_script_2 = GhPythonScript()  # -> out, lado_pilar, volume_concreto, area_forma
# ---------- ghpython_script_2: Python ----------
__author__ = "brunobrito"


class preDimensionamento_pilar:
    def __init__(self, caso_carga, altura_pilar, vao_um, vao_dois, numero_andares):
        self. caso_carga = caso_carga
        self.altura_pilar = altura_pilar
        self.vao_um = vao_um
        self.vao_dois = vao_dois
        self.numero_andares = numero_andares

    def area_influencia(self):
         return self.vao_um * self.vao_dois
    
    def carga_pilar(self):
        if self.caso_carga == 0:
            return (self.area_influencia() * 700) * self.numero_andares
        elif self.caso_carga == 1:
            return (self.area_influencia() * 800) * self.numero_andares
        elif self.caso_carga == 2:
            return (self.area_influencia() * 900) * self.numero_andares
        
    def area_secao(self):
        a = self.carga_pilar() / 100
        a = (a + (self.area_influencia() * 7))/2
        if a < 144:
            return (144/10000)
        else:
            return a/10000
    
    def lado_secao(self):
        return (self.area_secao() ** 0.5)

    def volume_concreto(self):
        return self.area_secao() * self.altura_pilar
    
    def area_forma(self):
        return self.lado_secao() * self.altura_pilar
    
    def peso_aco(self):
        return self.volume_concreto() * 100
        

pilar = preDimensionamento_pilar(caso_carga,altura_pilar, vao_largura, vao_profundidade, numero_andares)

lado_pilar = pilar.lado_secao()
volume_concreto = pilar.volume_concreto() * numero_pilares
area_forma = pilar.area_forma() * numero_pilares
# ---------- end ghpython_script_2 ----------
ghpython_script_3 = GhPythonScript()  # -> out, espessura_laje, volume_concreto, area_forma
# ---------- ghpython_script_3: Python ----------
__author__ = "brunobrito"

class preDimensionamento_laje:
    def __init__(self, vao_um, vao_dois):
        self.vao_um = vao_um
        self.vao_dois = vao_dois

    def maior_vao(self):
        return max(self.vao_um, self.vao_dois)
    
    def menor_vao(self):
        return min(self.vao_um, self.vao_dois)

    def altura_laje(self):
        if self.maior_vao()/self.menor_vao() >= 2:
            return self.menor_vao() * 0.02
        elif self.maior_vao()/self.menor_vao() < 2:
            return ((self.maior_vao() + self.menor_vao())/2) * 0.02
        
    def volume_concreto(self):
        return self.maior_vao() * self.menor_vao() * self.altura_laje()
    
    def area_forma(self):
        return self.maior_vao() * self.menor_vao()
    
    def peso_aco(self):
        return self.volume_concreto() * 100
        
        
laje = preDimensionamento_laje(vao_largura, vao_profundidade)

espessura_laje = laje.altura_laje()
volume_concreto = laje.volume_concreto()*numero_lajes
area_forma = laje.area_forma()*numero_lajes
# ---------- end ghpython_script_3 ----------
